# Grasshopper definition sort_curves.gh (Grasshopper 1.0.8)

list = ValueList({"1k random points": 0, "5k random points": 1, "10k random points": 2, "50k random points": 3}, selected="1k random points")
crv = Curve([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])
crv_2 = Curve([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])
crv_3 = Curve([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])
crv_4 = Curve([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])
filter = StreamFilter(Gate=list, Stream0=crv, Stream1=crv_2, Stream2=crv_3, Stream3=crv_4)
S = Script(modules="sort_curves_component.py")  # -> script_dirs; inputs modules: list
# ---------- S: Python ----------
import os


def _find_src_dir(start_dir):
    """Walk up from start_dir looking for a directory containing geomseq/."""
    current = os.path.abspath(start_dir)
    while True:
        if os.path.isdir(os.path.join(current, "geomseq")):
            return current
        parent = os.path.dirname(current)
        if parent == current:  # hit filesystem root, not found
            return None
        current = parent


def _find_module_path(src_dir, module):
    """Search under src_dir for a file or folder named exactly `module`, at any depth."""
    for root, dirs, files in os.walk(src_dir):
        if module in dirs or module in files:
            return os.path.join(root, module)
    return None


gh_doc = ghenv.Component.OnPingDocument()
script_dirs = []

if not gh_doc.FilePath:
    print("[geomseq] can't resolve project src/ -- .gh document hasn't been saved yet")
else:
    src_dir = _find_src_dir(os.path.dirname(gh_doc.FilePath))
    if src_dir is None:
        print("[geomseq] can't find a 'geomseq' folder walking up from the .gh document's location")
    else:
        for module in modules:
            found = _find_module_path(src_dir, module)
            if found is None:
                print("[geomseq] module not found under src/: %s" % module)
            else:
                script_dirs.append(os.path.normpath(found))
# ---------- end S ----------
crv_5 = Curve(filter)
partition = PartitionList(List=crv_5, Size="500")

# ---- group: Release!
dam = DataDam(DataA=crv_5, BufferDelay=10000000, BufferMode=0)

# ----
panel = Panel(S)
sort_curves = MyPythonEditer(script=S, curves_tree=dam, if_flip=Toggle(True))  # -> out, sorted_curves_tree, travel_lines_tree, full_path_tree, full_types_tree, reversed_tree; inputs curves_tree: tree of Curve, start_point: Point3d, if_flip: Boolean
#   port script: Script to execute
# ---------- sort_curves: Python ----------
__author__ = "Yen-Fen Chan"
__version__ = "0.1.0" # Updated to R-Tree version
__date__ = '2026.03.05'

import Rhino.Geometry as rg

def sort_curves_by_rtree_optimized(curves, start_point =rg.Point3d(0,0,0)):
    """
    使用 R-Tree 優化的貪婪路徑排序演算法。
    起始點設定為離 (0,0,0) 最近的曲線端點。
    """
    if not curves:
        return [], []
    
    # 1. 建立 R-Tree 與點位快取 (避免迴圈內重複存取 Rhino Object 屬性)
    id_to_point = {}
    rtree = rg.RTree()
    
    for i, c in enumerate(curves):
        start = c.PointAtStart
        end = c.PointAtEnd
        
        # 偶數 ID 代表 Start, 奇數 ID 代表 End
        s_id, e_id = i * 2, i * 2 + 1
        
        rtree.Insert(start, s_id)
        rtree.Insert(end, e_id)
        
        id_to_point[s_id] = start
        id_to_point[e_id] = end

    # 2. 尋找起始曲線：離 (0,0,0) 最近的端點
    first_idx = -1
    min_dist_to_sp = float("inf")
    first_is_rev = False

    for i, c in enumerate(curves):
        d_s = start_point.DistanceTo(c.PointAtStart)
        d_e = start_point.DistanceTo(c.PointAtEnd)
        
        if d_s < min_dist_to_sp:
            min_dist_to_sp = d_s
            first_idx = i
            first_is_rev = False
        if d_e < min_dist_to_sp:
            min_dist_to_sp = d_e
            first_idx = i
            first_is_rev = True

    # 初始化排序容器
    ordered_indices = [first_idx]
    reversals = [first_is_rev]
    used_indices = {first_idx}
    
    # 決定目前的最後一點位置
    last_pt = curves[first_idx].PointAtStart if first_is_rev else curves[first_idx].PointAtEnd

    # 3. 核心 R-Tree 搜尋迴圈
    while len(ordered_indices) < len(curves):
        # 使用 list 存儲最佳結果以供 callback 修改
        # [best_idx, best_dist, need_reverse]
        best_match = [-1, float("inf"), False]

        def search_callback(sender, e):
            idx = e.Id // 2
            if idx in used_indices: 
                return
            
            this_pt = id_to_point[e.Id]
            dist = last_pt.DistanceTo(this_pt)
            
            if dist < best_match[1]:
                best_match[1] = dist
                best_match[0] = idx
                best_match[2] = (e.Id % 2 == 1) # 如果撞到對方的 End，則該線需反轉

        # 執行 R-Tree 搜尋 (使用足夠大的球體範圍)
        rtree.Search(rg.Sphere(last_pt, 1000000), search_callback)

        next_idx = best_match[0]
        if next_idx == -1: 
            break # 防止異常中斷
        
        used_indices.add(next_idx)
        ordered_indices.append(next_idx)
        
        need_rev = best_match[2]
        reversals.append(need_rev)
        
        # 更新最後一點
        next_curve = curves[next_idx]
        last_pt = next_curve.PointAtStart if need_rev else next_curve.PointAtEnd

    # 4. 根據排序結果重建幾何物件
    ordered_curves = []
    for idx, rev in zip(ordered_indices, reversals):
        new_c = curves[idx].Duplicate()
        if rev: 
            new_c.Reverse()
        ordered_curves.append(new_c)

    return ordered_curves, ordered_indices

# --- 執行排序 ---
sorted_paths, ori_indices = sort_curves_by_rtree_optimized(unsorted_paths, start_point=rg.Point3d(31.9,80,0))
# ---------- end sort_curves ----------
crv_6 = Curve(sort_curves.travel_lines_tree)
